# Grasshopper definition lululemon.gh (Grasshopper 1.0.7)

crv = Curve(<curve referenced from the Rhino model>)
crv_2 = Curve([<curve referenced from the Rhino model> x3])
end = EndPoints(Curve=crv)  # -> Start, End
swp1 = Sweep1(Rail=crv, Sections=crv_2, Miter=1)
Y = UnitY(Factor=1)

# ----
# Rib Generator
neg = Negative(Value=Slider(0.3, range=0..1))
contour = Contour(Shape=swp1, Point=end.Start, Direction=Y, Distance=Slider(0.4, range=0..3))  # -> simplify(Contours)
offset = OffsetCurve(Curve=contour, Distance=neg, Corners=1)  # -> simplify(Curve)
end_2 = EndPoints(Curve=offset)  # -> Start, End
end_3 = EndPoints(Curve=contour)  # -> Start, End
ln = Line(StartPoint=end_3.End, EndPoint=end_2.End)
ln_2 = Line(StartPoint=end_3.Start, EndPoint=end_2.Start)
join = JoinCurves(Curves=[contour, ln, offset, ln_2], Preserve=False)  # -> simplify(Curves)
Y_2 = UnitY(Factor=1)
offset_2 = OffsetCurve(Curve=join, Distance=Slider(0.1, range=0..1), Plane=Y_2, Corners=1)  # -> simplify(Curve)
loft = Loft(
    Curves=[join, offset_2],
    Options={Adjust=False, Closed=False, LoftEnds=0, LoftSimp=0, LoftType=0, Rebuild=10, Refit=0.01})

series = Series(Start=0, Step=Slider(0.712, range=0..1), Count=Slider(0, range=0..100))
yz = YZPlane(Origin=Point(0, 0, 0))
cyl = Cylinder(Base="10.20,.3,-1", Radius=Slider(0.116, range=0..1), Length=Slider(5.762, range=0..10))
srf = Surface(<surface referenced from the Rhino model>)
rad = Radians(Degrees=Slider(90, range=0..180))
Y_3 = UnitY(Factor=Slider(0.499, range=0..1))
yz_2 = YZPlane(Origin=Point(0, 0, 0))
cyl_2 = Cylinder(Base=".75,.4,-1", Radius=Slider(0.12, range=0..1), Length=Slider(4.764, range=0..10))
rad_2 = Radians(Degrees=Slider(90, range=0..180))
Y_4 = UnitY(Factor=Slider(0.25, range=0..1))
yz_3 = YZPlane(Origin=Point(0, 0, 0))
cyl_3 = Cylinder(Base="4.75,.4,-1", Radius=Slider(0.12, range=0..1), Length=Slider(4.764, range=0..10))
rad_3 = Radians(Degrees=Slider(90, range=0..180))
rotate = Rotate(Geometry=cyl, Angle=rad, Plane=yz)  # -> Geometry, Transform
Y_5 = UnitY(Factor=Slider(0.499, range=0..1))
yz_4 = YZPlane(Origin=Point(0, 0, 0))
cyl_4 = Cylinder(Base="2.75,7.25,-1", Radius=Slider(0.12, range=0..1), Length=Slider(4.764, range=0..10))
offset_3 = OffsetSurface(Surface=srf, Distance=Y_3, Retrim=True)
rad_4 = Radians(Degrees=Slider(90, range=0..180))
extr = Extrude(Base=srf, Direction=Y_4)
cap = CapHoles(Brep=rotate.Geometry)
rotate_2 = Rotate(Geometry=cyl_2, Angle=rad_2, Plane=yz_2)  # -> Geometry, Transform
Y_6 = UnitY(Factor=Slider(0.25, range=0..1))
Y_7 = UnitY(Factor=Slider(0.499, range=0..1))
rotate_3 = Rotate(Geometry=cyl_3, Angle=rad_3, Plane=yz_3)  # -> Geometry, Transform
offset_4 = OffsetSurface(Surface=offset_3, Distance=Y_5, Retrim=True)
Y_8 = UnitY(Factor=Slider(0.25, range=0..1))
extr_2 = Extrude(Base=offset_3, Direction=Y_6)
rotate_4 = Rotate(Geometry=cyl_4, Angle=rad_4, Plane=yz_4)  # -> Geometry, Transform
offset_5 = OffsetSurface(Surface=offset_4, Distance=Y_7, Retrim=True)
Y_9 = UnitY(Factor=Slider(0.499, range=0..1))
offset_6 = OffsetSurface(Surface=srf, Distance=series, Retrim=True)
Y_10 = UnitY(Factor=Slider(0.25, range=0..1))
extr_3 = Extrude(Base=offset_4, Direction=Y_8)
Y_11 = UnitY(Factor=Slider(0.499, range=0..1))
offset_7 = OffsetSurface(Surface=offset_5, Distance=Y_9, Retrim=True)
extr_4 = Extrude(Base=offset_5, Direction=Y_10)
Y_12 = UnitY(Factor=Slider(0.25, range=0..1))
Y_13 = UnitY(Factor=Slider(0.499, range=0..1))
offset_8 = OffsetSurface(Surface=offset_7, Distance=Y_11, Retrim=True)
Y_14 = UnitY(Factor=Slider(0.25, range=0..1))
cap_2 = CapHoles(Brep=loft)
sdiff = SolidDifference(BrepsA=cap_2, BrepsB=cap)
extr_5 = Extrude(Base=offset_7, Direction=Y_12)
Y_15 = UnitY(Factor=Slider(0.499, range=0..1))
offset_9 = OffsetSurface(Surface=offset_8, Distance=Y_13, Retrim=True)
extr_6 = Extrude(Base=offset_8, Direction=Y_14)
Y_16 = UnitY(Factor=Slider(0.25, range=0..1))
offset_10 = OffsetSurface(Surface=offset_9, Distance=Y_15, Retrim=True)
Y_17 = UnitY(Factor=Slider(0.25, range=0..1))
extr_7 = Extrude(Base=offset_9, Direction=Y_16)
extr_8 = Extrude(Base=offset_10, Direction=Y_17)
